% Simulink data dictionary Constants.sldd

L = Simulink.Parameter(0.25)
R = Simulink.Parameter(0.05)
kb = 0.05
ki = 0.05
l = 0.5
r = 1.5
J = 5
M = 20
c = 0.05
mass_robot = Simulink.Parameter(20)
robot_height = Simulink.Parameter(5)
gravity = Simulink.Parameter(9.8)
mass_payload = Simulink.Parameter(10)
ks = 0.9311376
cs = Simulink.Parameter(22.35786)